# Grasshopper definition test 2 gh dans TS.gh (Grasshopper 1.0.7)

c_script = CSharpScript(
    Value=Slider(11, range=1..15),
    ParameterName="Number",
    Reference=["C:\Sources\Topsolid 7.14\Debug x64\TopSolid.Kernel.Automating.dll", "C:\Sources\Topsolid 7.14\Debug x64\TopSolid.Kernel.Automating.Host.dll", "C:\Sources\Topsolid 7.14\Debug x64\TopSolid.Kernel.DB.D2.dll", "C:\Sources\Topsolid 7.14\Debug x64\TopSolid.Kernel.DB.D2.Modeling.dll", "C:\Sources\Topsolid 7.14\Debug x64\TopSolid.Kernel.DB.D2.Sketches.dll", "C:\Sources\Topsolid 7.14\Debug x64\TopSolid.Kernel.DB.D3.dll"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])  # -> out, A; inputs Value: Int32
# ---------- c_script: C# usings ----------
using TopSolid;
using TopSolid.Kernel.DB.D3.Documents;
using TopSolid.Kernel.DB.Documents;
using TopSolid.Kernel.DB.Entities;
using TopSolid.Kernel.DB.Parameters;
using TopSolid.Kernel.DB.SmartObjects;
using TopSolid.Kernel.UI.Selections;
# ---------- c_script: C# ----------
    GeometricDocument document = TopSolid.Kernel.UI.Application.CurrentDocument as GeometricDocument;
    TopSolid.Kernel.TX.Undo.UndoSequence.UndoCurrent();
    TopSolid.Kernel.TX.Undo.UndoSequence.Start("Test", true);

    //TextParameterEntity texte = document.ParametersFolderEntity.FindEntity("TestparamSpeckle") as TextParameterEntity;
    //    TextParameterEntity texte = new TextParameterEntity(document, 0);
    //    texte.Value = (JsonConvert.SerializeObject(state));
    //texte.Value = "convertedJson";
    //    texte.Name = "TestparamSpeckle";
    //    document.ParametersFolderEntity.AddEntity(texte);
    IntegerParameterEntity L = document.ParametersFolderEntity.GetEntity(3)as IntegerParameterEntity;
    L.Value = Value;
    A = L;
    TopSolid.Kernel.UI.Application.Update();


    TopSolid.Kernel.TX.Undo.UndoSequence.End();
# ---------- end c_script ----------
panel = Panel(c_script.A)
